# Grasshopper definition AugmentedFabrication.gh (Grasshopper 1.0.7)
# plug-ins: FologramForGrasshopper, Human, MetaHopper, Pufferfish

sync_parameters = SyncParameters(
    augmented_trigger_0_key=piece_index,
    augmented_trigger_11_key=number_slider_3,
    augmented_trigger_13_key=number_slider,
    augmented_trigger_15_key=number_slider_5,
    augmented_trigger_17_key=number_slider_6,
    augmented_trigger_1_key=show,
    augmented_trigger_2_key=number_slider_2,
    augmented_trigger_5_key=number_slider_4,
    componentVersion=1,
    num_augmented_triggers=18)

piece_index = Slider(61, range=0..61)
assembly_2 = Brep([<brep referenced from the Rhino model> x61])
assembly_1 = Geometry([<brep referenced from the Rhino model> x12])
show = Button()
frame = Geometry([<brep referenced from the Rhino model> x3])

mesh = Mesh([<mesh referenced from the Rhino model> x325])  # disabled
subd_from_mesh = SubDFromMesh(Mesh=mesh, Creases=1, Corners=1, Interpolate=False)
assembly_3 = Brep([<brep referenced from the Rhino model> x12])
assembly_4 = Brep([<brep referenced from the Rhino model> x326])  # disabled
frame_2 = Geometry([<brep referenced from the Rhino model> x2])
frame_3 = Relay([frame_2, frame])

number_slider = Slider(0, range=0..100)
brep = Brep(assembly_2)
volume = Volume(Geometry=brep)  # -> Volume, Centroid
round = Round(Number=volume.Volume)  # -> Nearest, Floor, Ceiling
create_set = CreateSet(List=round.Nearest)  # -> Set, Map
member_index = MemberIndex(Set=round.Nearest, Member=create_set.Set)  # -> simplify(Index), Count
list_item = ListItem(List=brep, Index=member_index.Index, Wrap=True)
brep_2 = Brep(list_item)
bounding_box = BoundingBox(Content=brep_2, Plane=PlaneXY(0, 0, 0))  # -> Box, Box_2
deconstruct_brep = DeconstructBrep(Brep=brep_2)  # -> Faces, Edges, Vertices
deconstruct = Deconstruct(Point=deconstruct_brep.Vertices)  # -> XComponent, YComponent, ZComponent
construct_point = ConstructPoint(XCoordinate=deconstruct.XComponent, YCoordinate=deconstruct.YComponent, ZCoordinate=number_slider)
convex_hull = ConvexHull(Points=construct_point, Plane=PlaneXY(0, 0, 0))  # -> Hull, HullZ, Indices
curve = Curve(convex_hull.Hull)
explode = Explode(Curve=curve, Recursive=True)  # -> Segments, Vertices
segment_lengths = SegmentLengths(Curve=curve)  # -> ShortestLength, ShortestDomain, LongestLength, LongestDomain
length = Length(Curve=explode.Segments)
similarity = Similarity(FirstNumber=segment_lengths.ShortestLength, SecondNumber=length, Threshold=0.1)  # -> Similarity, AbsoluteDifference
geometry = Geometry(flatten(list_item))
ghpython_script = GhPythonScript(x=similarity.Similarity)  # -> out, a; inputs x: list of Boolean
# ---------- ghpython_script: Python ----------
__author__ = "Paris"
__version__ = "2022.09.23"

import rhinoscriptsyntax as rs

isSquare = True
for t in x:
    if(t == False):
        isSquare = False

a = isSquare
# ---------- end ghpython_script ----------
panel = Panel(ghpython_script.a)
dispatch = Dispatch(List=geometry, DispatchPattern=invert(flatten(panel)))  # -> ListA, ListB

list_length = ListLength(List=assembly_2)
number_slider_2 = Slider(5, range=0..11)
construct_domain = ConstructDomain(DomainStart=0, DomainEnd=list_length)
get_selected_objects = GetSelectedObjects(AllObjects_Object=piece_index)  # -> ComponentObjects, ParamObjects, OtherObjects
set_slider_properties = SetSliderProperties(Slider=get_selected_objects.ParamObjects, Value=number_slider_2, Range=construct_domain, Type=1)

brep_3 = Brep(dispatch.ListB)
bounding_box_2 = BoundingBox(Content=brep_3, Plane=PlaneXY(0, 0, 0))  # -> Box, Box_2
brep_brep = BrepBrep(BrepA=bounding_box_2.Box, BrepB=brep_3)  # -> Curves, Points
deconstruct_brep_2 = DeconstructBrep(Brep=bounding_box_2.Box)  # -> Faces, Edges, flatten(Vertices)
deconstruct_brep_3 = DeconstructBrep(Brep=brep_3)  # -> Faces, Edges, Vertices
curve_middle = CurveMiddle(Curve=brep_brep.Curves)
closest_point = ClosestPoint(Point=deconstruct_brep_2.Vertices, Cloud=deconstruct_brep_3.Vertices)  # -> ClosestPoint, CPIndex, Distance
deconstruct_2 = Deconstruct(Point=curve_middle)  # -> XComponent, YComponent, ZComponent
volume_2 = Volume(Geometry=brep_3)  # -> Volume, Centroid
list_item_2 = ListItem(List=closest_point.ClosestPoint, Index=0, Wrap=True)
unit_y = UnitY(Factor=1)
sort_list = SortList(Keys=simplify(deconstruct_2.ZComponent), ValuesValuesA=simplify(brep_brep.Curves))  # -> Keys, reverse(ValuesValuesA)
number_slider_3 = Slider(0, range=0..100)
list_item_3 = ListItem(List=sort_list.ValuesValuesA, Index=0, Wrap=True)
curve_middle_2 = CurveMiddle(Curve=list_item_3)
end_points = EndPoints(Curve=list_item_3)  # -> Start, End
evaluate_curve = EvaluateCurve(Curve=reparameterize(list_item_3), Parameter=number_slider_3)  # -> Point, Tangent, Angle
merge = Merge(Data1=end_points.Start, Data2=end_points.End)
deconstruct_3 = Deconstruct(Point=merge)  # -> XComponent, YComponent, ZComponent
line = Line(StartPoint=graft(volume_2.Centroid), EndPoint=list_item_2)
sort_list_2 = SortList(Keys=deconstruct_3.YComponent, ValuesValuesA=merge)  # -> Keys, reverse(ValuesValuesA)
list_item_4 = ListItem(List=sort_list_2.ValuesValuesA, Index=0, Wrap=True)
vector_2pt = Vector2Pt(PointA=curve_middle_2, PointB=list_item_4, Unitize=False)  # -> Vector, Length
angle = Angle(VectorA=vector_2pt.Vector, VectorB=unit_y)  # -> Angle, Reflex
number = Number(angle.Angle)
list_item_5 = ListItem(List=number, Index=0, Wrap=True)
trim_tree = TrimTree(Tree=graft(list_item_5), Depth=1)
sort_list_3 = SortList(Keys=flatten(trim_tree), ValuesValuesA=brep_3)  # -> Keys, ValuesValuesA
last_index = LastIndex(List=sort_list_3.Keys)
list_item_6 = ListItem(List=sort_list_3.Keys, Index=last_index, Wrap=True)
list_item_7 = ListItem(List=sort_list_3.Keys, Index=0, Wrap=True)
construct_domain_2 = ConstructDomain(DomainStart=list_item_7, DomainEnd=list_item_6)
remap_numbers = RemapNumbers(Value=trim_tree, Source=construct_domain_2, Target=Domain(0, 1))  # -> Mapped, Clipped

brep_4 = Brep(dispatch.ListA)
deconstruct_brep_4 = DeconstructBrep(Brep=brep_4)  # -> Faces, Edges, Vertices
deconstruct_4 = Deconstruct(Point=deconstruct_brep_4.Vertices)  # -> XComponent, YComponent, ZComponent
number_slider_4 = Slider(0, range=0..100)
construct_point_2 = ConstructPoint(XCoordinate=deconstruct_4.XComponent, YCoordinate=deconstruct_4.YComponent, ZCoordinate=number_slider_4)
convex_hull_2 = ConvexHull(Points=construct_point_2, Plane=PlaneXY(0, 0, 0))  # -> Hull, HullZ, Indices
curve_2 = Curve(convex_hull_2.Hull)
segment_lengths_2 = SegmentLengths(Curve=curve_2)  # -> ShortestLength, ShortestDomain, LongestLength, LongestDomain
explode_2 = Explode(Curve=curve_2, Recursive=True)  # -> Segments, Vertices
number_slider_5 = Slider(10, range=0..10)
length_2 = Length(Curve=explode_2.Segments)
unit_y_2 = UnitY(Factor=1)
similarity_2 = Similarity(FirstNumber=segment_lengths_2.ShortestLength, SecondNumber=length_2, Threshold=number_slider_5)  # -> Similarity, AbsoluteDifference
similarity_3 = Similarity(FirstNumber=segment_lengths_2.LongestLength, SecondNumber=length_2, Threshold=number_slider_5)  # -> Similarity, AbsoluteDifference
dispatch_2 = Dispatch(List=explode_2.Segments, DispatchPattern=similarity_2.Similarity)  # -> ListA, ListB
dispatch_3 = Dispatch(List=explode_2.Segments, DispatchPattern=similarity_3.Similarity)  # -> ListA, ListB
curve_middle_3 = CurveMiddle(Curve=dispatch_2.ListA)
curve_middle_4 = CurveMiddle(Curve=dispatch_3.ListA)
list_item_8 = ListItem(List=curve_middle_3, Index=0, Wrap=True)
list_item_9 = ListItem(List=curve_middle_3, Index=1, Wrap=True)
list_item_10 = ListItem(List=curve_middle_4, Index=0, Wrap=True)
list_item_11 = ListItem(List=curve_middle_4, Index=1, Wrap=True)
number_slider_6 = Slider(0, range=0..100)
line_2 = Line(StartPoint=list_item_10, EndPoint=list_item_11)
vector_2pt_2 = Vector2Pt(PointA=list_item_8, PointB=list_item_9, Unitize=False)  # -> Vector, Length
line_3 = Line(StartPoint=list_item_8, EndPoint=list_item_9)
vector_2pt_3 = Vector2Pt(PointA=list_item_10, PointB=list_item_11, Unitize=False)  # -> Vector, Length
vector_length = VectorLength(Vector=vector_2pt_3.Vector)
vector_length_2 = VectorLength(Vector=vector_2pt_2.Vector)
equality = Equality(FirstNumber=vector_length, SecondNumber=number_slider_6)  # -> Equality, Inequality
equality_2 = Equality(FirstNumber=vector_length_2, SecondNumber=number_slider_6)  # -> Equality, Inequality
dispatch_4 = Dispatch(List=vector_2pt_2.Vector, DispatchPattern=equality_2.Equality)  # -> ListA, ListB
dispatch_5 = Dispatch(List=vector_2pt_3.Vector, DispatchPattern=equality_2.Inequality)  # -> ListA, ListB

dispatch_6 = Dispatch(List=dispatch_5.ListB, DispatchPattern=equality.Equality)  # -> ListA, ListB

merge_2 = Merge(Data1=dispatch_4.ListB, Data2=dispatch_6.ListB)
angle_2 = Angle(VectorA=merge_2, VectorB=unit_y_2)  # -> Angle, Reflex
vector_display = VectorDisplay(Anchor=merge_2, Vector=merge_2)
number_2 = Number(angle_2.Angle)
sort_list_4 = SortList(Keys=flatten(number_2))  # -> Keys, ValuesValuesA
last_index_2 = LastIndex(List=sort_list_4.Keys)
list_item_12 = ListItem(List=sort_list_4.Keys, Index=last_index_2, Wrap=True)
list_item_13 = ListItem(List=sort_list_4.Keys, Index=0, Wrap=True)
construct_domain_3 = ConstructDomain(DomainStart=list_item_13, DomainEnd=list_item_12)
remap_numbers_2 = RemapNumbers(Value=number_2, Source=construct_domain_3, Target=Domain(0, 1))  # -> Mapped, Clipped

layer_table = LayerTable(Update=True, AutoUpdate=False)  # -> Layers, FullLayerPaths, LayerColors, Linetypes, MaterialNames, Visible, PrintWidth, PrintColor
weave = Weave(Pattern=flatten(panel), Stream0=flatten(remap_numbers_2.Mapped), Stream1=flatten(remap_numbers.Mapped), NullGaps=False)
list_item_14 = ListItem(List=layer_table.Layers, Index=0, Wrap=True)
gradient = Gradient(
    LowerLimit=0,
    UpperLimit=1,
    Parameter=weave,
    stops=[0: RGB(0, 98, 0), 0.25: RGB(81, 175, 17), 0.5: RGB(159, 198, 146), 0.75: RGB(170, 235, 41), 1: RGB(221, 255, 53)])
deleteonlayer = DeleteOnLayer(Run=show, Layer=list_item_14, enableFullPath=False)
mesh_brep = MeshBrep(
    Brep=assembly_2,
    Settings={GridMaxCount=0, GridMinCount=16, JaggedSeams=False, MaxEdgeLength=0, MinEdgeLength=0.0001, MinTolerance=0, Refine=True, RefineAngle=0, RelativeTolerance=0.65, SimplePlanes=True, Tolerance=0})
panel_2 = Panel(gradient)
mesh_colours = MeshColours(Mesh=graft(mesh_brep), Colours=graft(gradient))
c_script = CSharpScript(x=flatten(mesh_colours), y=piece_index)  # -> out, A, B; inputs x: list of Mesh, y: Int32
# ---------- c_script: C# ----------
    int nend = y > x.Count ? x.Count : y;
    var outlist = new List<Mesh>();
    int[] outlistInt = new int[nend];
    for(int i = 0;i < nend;i++)
    {
      outlist.Add(x[i]);
      outlistInt[i] = i;
    }
    A = outlist;
    B = outlistInt;
# ---------- end c_script ----------
geometry_2 = Geometry(c_script.A)
bake_geometry = BakeGeometry(Bake=deleteonlayer, Geometry=geometry_2, Attributes=list_item_14, DeleteOldBakes=False, PreserveTrees=False)
custom_preview = CustomPreview(Geometry=geometry_2, Material=gradient)
custom_preview_2 = CustomPreview(Geometry=frame_3, Material=ColourSwatch(SwatchColor=RGBA(214, 214, 214, 110)))
