# Grasshopper definition Karamba displacement Visualisation.gh (Grasshopper 1.0.7)
# plug-ins: Karamba3D, Human, Pufferfish

support = Brep([<brep referenced from the Rhino model> x2])
brep = Brep([<brep referenced from the Rhino model> x61])

brep_2 = Brep([<brep referenced from the Rhino model> x72])

brep_3 = Brep([<brep referenced from the Rhino model> x12])
support_2 = Brep([<brep referenced from the Rhino model> x3])

brep_4 = Brep([<brep referenced from the Rhino model> x24])
brep_5 = Brep([<brep referenced from the Rhino model> x4])

supportcurv = Curve(<curve referenced from the Rhino model>)
brep_6 = Brep(<brep referenced from the Rhino model>)

boolean_toggle = BooleanToggle(True)
quad_remesh_settings = QuadRemeshSettings(
    TargetCount=Slider(1000, range=0..1000),
    AdaptiveSize=Slider(50, range=0..100),
    AdaptiveCount=False,
    HardEdges=boolean_toggle,
    SeamEdges=boolean_toggle,
    Symmetry=0,
    GuideCurves=0)
solid_union = SolidUnion(Breps=brep_2)
quad_remesh = QuadRemesh(Mesh=solid_union, Settings=quad_remesh_settings)

divide_curve = DivideCurve(Curve=supportcurv, Count=Slider(100, range=0..100), Kinks=False)  # -> Points, Tangents, Parameters

deconstruct_mesh = DeconstructMesh(Mesh=quad_remesh)  # -> Vertices, Faces, Colours, Normals
deconstruct = Deconstruct(Point=deconstruct_mesh.Vertices)  # -> XComponent, YComponent, ZComponent
sort_list = SortList(Keys=deconstruct.ZComponent, ValuesA=deconstruct_mesh.Vertices)  # -> Keys, ValuesA
split_list = SplitList(List=sort_list.ValuesA, Index=Slider(47, range=0..100))  # -> ListA, ListB

mesh_brep = MeshBrep(Settings={GridMaxCount=0, GridMinCount=16, JaggedSeams=False, MaxEdgeLength=0, MinEdgeLength=0.0001, MinTolerance=0, Refine=True, RefineAngle=0, RelativeTolerance=0.65, SimplePlanes=True, Tolerance=0})
mesh_union = MeshUnion(Meshes=mesh_brep)
deconstruct_mesh_2 = DeconstructMesh(Mesh=mesh_union)  # -> Vertices, Faces, Colours, Normals
closest_points_karamba3d = ClosestPointsKaramba3D(
    Point=deconstruct_mesh_2.Vertices,
    Cloud=flatten(deconstruct_mesh.Vertices),
    NumberOfNeighbors=Slider(5, range=0..10),
    LimitDistance=Slider(2, range=0..10))  # -> flatten(Points), Index, Distance
dispatch = Dispatch(List=closest_points_karamba3d.Points, DispatchPattern=[True, False, False, False, False])  # -> ListA, ListB

mesh = Mesh(quad_remesh)
point = Point(split_list.ListA)

# ---- group: Reference Geometry
pt = Point(flatten(point))

# ---- group: Define Elements
panel = Panel("baseShell")
meshtoshell = MeshToShellKaramba3D(Mesh=mesh, Identifier=panel, LimitDistance_m=0.005)  # -> Element, Points, Info

# ---- group: Define Loads
live_load = Slider(-2, range=-5..5)
mesh_2 = Mesh(mesh)
Z = UnitZ(Factor="-1")
Z_2 = UnitZ(Factor=live_load)
loads = LoadsKaramba3D(Vector=Z, LCase="0", mode="Gravity")
loads_2 = LoadsKaramba3D(Vector=Z_2, Mesh=mesh_2, LCase="0", mode="MeshLoad -Const.", menu=[buttons(on, off, off), buttons(on, off)])
load = LoadKaramba3D(flatten([loads_2, loads]))

# ---- group: Define Supports
fsim = FindSimilarMember(Data=pt, Set=meshtoshell.Points)  # -> Hit, Index
supp = SupportKaramba3D(PosInd=fsim.Hit, PlaneOfReference=pt, menu=[buttons(on, on, on, on, on, on)])

# ---- group: Assemble Model
assemble = AssembleModelKaramba3D(Elem=meshtoshell.Element, Support=supp, Load=load, LimitDistance_m=0.005)  # -> Model, Info, Mass_kg, CenterOfGravity, LoadCaseNames

# ----
panel_2 = Panel(assemble.Info)

# ---- group: Analyze Model
analyze = AnalyzeKaramba3D(Model=assemble.Model)  # -> CalculatedModel, MaximumDisplacement_cm, ResultingForceOfGravity_kN, ElasticEnergy_kNm
displacement = Panel(analyze.MaximumDisplacement_cm)

# ---- group: View Results
modelview = ModelViewKaramba3D(Model=analyze.CalculatedModel, ResultFactors=Slider(0.1, range=0..1), ResultCase=-1)  # -> Model, DeformedMesh, DeformedAxes, DeformedModel
shellview = ShellViewKaramba3D(Model=modelview.Model, IndexOfLayer=0)  # -> Model, MeshesOfRenderedShells, LegendColors, LegendTags
legend = Legend(Colour=shellview.LegendColors, Tags=shellview.LegendTags, LegendType=101)

# ----
shell_forces_karamba3d = ShellForcesKaramba3D(AnalyzedModel=modelview.Model, mode="Local")  # -> AnalyzedModel, Nxx_kN_m, Nyy_kN_m, Nxy_kN_m, Mxx_kNm_m, Myy_kNm_m, Mxy_kNm_m, Vx_kN_m, Vy_kN_m
bounds = Bounds(Numbers=shell_forces_karamba3d.Nxx_kN_m)
deconstruct_domain = DeconstructDomain(Domain=bounds)  # -> Start, End
gradient = Gradient(
    LowerLimit=deconstruct_domain.Start,
    UpperLimit=deconstruct_domain.End,
    Parameter=shell_forces_karamba3d.Nxx_kN_m,
    stops=[0: RGB(16, 69, 171), 0: RGB(154, 154, 73), 0: RGB(241, 104, 17), 1: RGB(0, 0, 255)])
construct_domain = ConstructDomain(DomainStart=0, DomainEnd=1)
construct_domain_2 = ConstructDomain(DomainStart=0, DomainEnd=255)
mesh_to_polysurface = MeshToPolysurface(Mesh=shellview.MeshesOfRenderedShells, Triangles=False, FaceMerge=False)
panel_3 = Panel(gradient)
text_split = TextSplit(Text=panel_3, Separators=",")  # -> simplify(Result)
remap_numbers = RemapNumbers(Value=text_split, Source=construct_domain_2, Target=construct_domain)  # -> Mapped, Clipped
list_item = ListItem(List=remap_numbers.Mapped, Index=1, Wrap=True)  # -> flatten(Item)
list_item_2 = ListItem(List=remap_numbers.Mapped, Index=0, Wrap=True)  # -> flatten(Item)
list_item_3 = ListItem(List=remap_numbers.Mapped, Index=0, Wrap=True)  # -> flatten(Item)
colour_rgb_f = ColourRGBF(Alpha=1, Red=list_item_2, Green=list_item, Blue=list_item_3)
custom_preview = CustomPreview(Geometry=mesh_to_polysurface, Material=colour_rgb_f)  # disabled
custom_preview_lineweights = CustomPreviewLineweights(Geometry=shellview.MeshesOfRenderedShells, Shader=colour_rgb_f, Thickness=Slider(0, range=0..0.1), Absolute=False)
mesh_3 = Mesh()  # disabled
shell_forces_karamba3d_2 = ShellForcesKaramba3D(LCase=0, mode="Principal")  # -> AnalyzedModel, FirstPrincipalNormalForce_kN_m, SecondPrincipalNormalForce_kN_m, FirstPrincipalMoment_kNm_m, SecondPrincipalMoment_kNm_m, ShearForceInLocalXDirection_kN_m, ShearForceInLocalYDirection_kN_m
shell_forces_karamba3d_3 = ShellForcesKaramba3D(LCase=0, mode="Principal")  # -> AnalyzedModel, FirstPrincipalNormalForce_kN_m, SecondPrincipalNormalForce_kN_m, FirstPrincipalMoment_kNm_m, SecondPrincipalMoment_kNm_m, ShearForceInLocalXDirection_kN_m, ShearForceInLocalYDirection_kN_m
shell_forces_karamba3d_4 = ShellForcesKaramba3D(LCase=0, mode="Principal")  # -> AnalyzedModel, FirstPrincipalNormalForce_kN_m, SecondPrincipalNormalForce_kN_m, FirstPrincipalMoment_kNm_m, SecondPrincipalMoment_kNm_m, ShearForceInLocalXDirection_kN_m, ShearForceInLocalYDirection_kN_m
shell_forces_karamba3d_5 = ShellForcesKaramba3D(LCase=0, mode="Principal")  # -> AnalyzedModel, FirstPrincipalNormalForce_kN_m, SecondPrincipalNormalForce_kN_m, FirstPrincipalMoment_kNm_m, SecondPrincipalMoment_kNm_m, ShearForceInLocalXDirection_kN_m, ShearForceInLocalYDirection_kN_m
bounds_2 = Bounds(Numbers=shell_forces_karamba3d_2.FirstPrincipalNormalForce_kN_m)
bounds_3 = Bounds(Numbers=shell_forces_karamba3d_3.FirstPrincipalNormalForce_kN_m)
bounds_4 = Bounds(Numbers=shell_forces_karamba3d_4.FirstPrincipalNormalForce_kN_m)
bounds_5 = Bounds(Numbers=shell_forces_karamba3d_5.FirstPrincipalNormalForce_kN_m)
deconstruct_domain_2 = DeconstructDomain(Domain=bounds_2)  # -> Start, End
deconstruct_domain_3 = DeconstructDomain(Domain=bounds_3)  # -> Start, End
deconstruct_domain_4 = DeconstructDomain(Domain=bounds_4)  # -> Start, End
deconstruct_domain_5 = DeconstructDomain(Domain=bounds_5)  # -> Start, End
gradient_2 = Gradient(
    LowerLimit=deconstruct_domain_2.Start,
    UpperLimit=deconstruct_domain_2.End,
    Parameter=shell_forces_karamba3d_2.FirstPrincipalNormalForce_kN_m,
    stops=[0.128: RGB(0, 0, 255), 0.5: RGB(255, 255, 240), 1: RGB(255, 0, 0)])
gradient_3 = Gradient(LowerLimit=0, UpperLimit=1, stops=[0.128: RGB(0, 0, 255), 0.5: RGB(255, 255, 240), 1: RGB(255, 0, 0)])
gradient_4 = Gradient(
    LowerLimit=deconstruct_domain_3.Start,
    UpperLimit=deconstruct_domain_3.End,
    Parameter=shell_forces_karamba3d_3.FirstPrincipalNormalForce_kN_m,
    stops=[0.128: RGB(0, 0, 255), 0.5: RGB(255, 255, 240), 1: RGB(255, 0, 0)])
gradient_5 = Gradient(
    LowerLimit=deconstruct_domain_4.Start,
    UpperLimit=deconstruct_domain_4.End,
    Parameter=shell_forces_karamba3d_4.FirstPrincipalNormalForce_kN_m,
    stops=[0.128: RGB(0, 0, 255), 0.5: RGB(255, 255, 240), 1: RGB(255, 0, 0)])
gradient_6 = Gradient(
    LowerLimit=deconstruct_domain_5.Start,
    UpperLimit=deconstruct_domain_5.End,
    Parameter=shell_forces_karamba3d_5.FirstPrincipalNormalForce_kN_m,
    stops=[0.128: RGB(0, 0, 255), 0.5: RGB(255, 255, 240), 1: RGB(255, 0, 0)])
custom_preview_lineweights_2 = CustomPreviewLineweights(Shader=gradient_2, Absolute=False)
custom_preview_lineweights_3 = CustomPreviewLineweights(Shader=gradient_4, Absolute=False)
custom_preview_lineweights_4 = CustomPreviewLineweights(Shader=gradient_5, Absolute=False)
custom_preview_lineweights_5 = CustomPreviewLineweights(Shader=gradient_6, Absolute=False)

# ---- group: Set Modules
utilization = UtilizationOfElementsKaramba3D(AnalyzedModel=analyze.CalculatedModel, ElementsIdentifiers=panel, mode="Shells")  # -> AnalyzedModel, Utilization; disabled
s_forces = ShellForcesKaramba3D(AnalyzedModel=analyze.CalculatedModel, LCase=0, mode="Principal")  # -> AnalyzedModel, FirstPrincipalNormalForce_kN_m, SecondPrincipalNormalForce_kN_m, FirstPrincipalMoment_kNm_m, SecondPrincipalMoment_kNm_m, ShearForceInLocalXDirection_kN_m, ShearForceInLocalYDirection_kN_m; disabled
number_slider = Slider(5.322, range=0..10)  # disabled
bbox = BoundingBox(Content=mesh_3, Plane=PlaneXY(0, 0, 0))  # -> Box, Box_2; disabled
panel_4 = Panel("""215, 225, 225
215, 175, 175
215, 125, 125
219, 50, 0""")  # disabled
legend_2 = Legend(Colour=panel_4, Tags=panel_4, LegendType=1)  # disabled

# ---- group: Set Modules / Compute Face Averages: Utilization
cull = CullPattern(List=utilization.Utilization, CullPattern=[False, True])  # -> graft(List); disabled
cull_2 = CullPattern(List=utilization.Utilization, CullPattern=[True, False])  # -> graft(List); disabled
avr = Average(Input=simplify([cull, cull_2]))  # disabled
bnd = Bounds(Numbers=flatten(utilization.Utilization))  # disabled
remap = RemapNumbers(Value=avr, Source=bnd, Target=Domain(0, 1))  # -> Mapped, Clipped; disabled

# ---- group: Set Modules / Compute Face Averages: In-Plane Force
cull_3 = CullPattern(List=s_forces.FirstPrincipalNormalForce_kN_m, CullPattern=[True, False])  # -> graft(List); disabled
cull_4 = CullPattern(List=s_forces.FirstPrincipalNormalForce_kN_m, CullPattern=[False, True])  # -> graft(List); disabled
avr_2 = Average(Input=simplify([cull_4, cull_3]))  # disabled
bnd_2 = Bounds(Numbers=flatten(s_forces.FirstPrincipalNormalForce_kN_m))  # disabled
remap_2 = RemapNumbers(Value=avr_2, Source=bnd_2, Target=Domain(0, 1))  # -> Mapped, Clipped; disabled

# ---- group: Set Modules / Compute Face Averages: Moment Force
cull_5 = CullPattern(List=s_forces.FirstPrincipalMoment_kNm_m, CullPattern=[False, True])  # -> graft(List); disabled
cull_6 = CullPattern(List=s_forces.FirstPrincipalMoment_kNm_m, CullPattern=[True, False])  # -> graft(List); disabled
avr_3 = Average(Input=simplify([cull_5, cull_6]))  # disabled
bnd_3 = Bounds(Numbers=flatten(s_forces.FirstPrincipalMoment_kNm_m))  # disabled
remap_3 = RemapNumbers(Value=avr_3, Source=bnd_3, Target=Domain(0, 1))  # -> Mapped, Clipped; disabled

# ---- group: Set Modules / remap results to number of reference modules
# PLUG IN DIFFERENT FORCE
# TYPES TO SEE RESULTS
graph = GraphMapper(
    remap_3.Mapped,
    x0=0,
    x1=1,
    y0=0,
    y1=1,
    container_name="Bezier",
    cpx=[0, 0.4590162337, 0.9913064837, 1],
    cpy=[0, 0.5364995003, 1, 1])  # disabled
panel_5 = Panel("0 to 3")  # disabled
remap_4 = RemapNumbers(Value=flatten(graph), Source=Domain(0, 1), Target=panel_5)  # -> Mapped, Clipped; disabled

# ---- group: Set Modules / split list into boolean pattern for each reference module
number_slider_2 = Slider(0, range=0..100)  # disabled
int = Integer(remap_4.Mapped)  # disabled
addition = Addition(A=number_slider_2, B=1)  # disabled
addition_2 = Addition(A=addition, B=1)  # disabled
addition_3 = Addition(A=addition_2, B=1)  # disabled
equals = Equality(FirstNumber=number_slider_2, SecondNumber=int)  # -> Equality, Inequality; disabled
equals_2 = Equality(FirstNumber=addition, SecondNumber=int)  # -> Equality, Inequality; disabled
equals_3 = Equality(FirstNumber=addition_2, SecondNumber=int)  # -> Equality, Inequality; disabled
equals_4 = Equality(FirstNumber=addition_3, SecondNumber=int)  # -> Equality, Inequality; disabled
entwine = Entwine(
    Branch00=equals.Equality,
    Branch01=equals_2.Equality,
    Branch02=equals_3.Equality,
    Branch03=equals_4.Equality,
    FlattenInputs=True)  # disabled

# ----
mesh_box = MeshBox(Base=mesh_3, XCount=number_slider, YCount=number_slider, ZCount=number_slider)  # disabled

# ---- group: Set Modules (continued)
cull_7 = CullPattern(List=mesh_box, CullPattern=entwine)  # disabled
morph = BoxMorph(Geometry=mesh_3, Reference=bbox.Box, Target=cull_7)  # disabled
preview = CustomPreview(Geometry=morph, Shader=panel_4)  # disabled

# ----
panel_6 = Panel(morph)  # disabled
